# Grasshopper definition ExportTest.gh (Grasshopper 1.0.7)
# plug-ins: Shachihoko

# ----
# モデル
number_slider = Slider(10, range=0..10)
center_box = CenterBox(Base=PlaneXY(0, 0, 0), X=Slider(6, range=0..10), Y=Slider(2.5, range=0..10), Z=number_slider)
construct_point = ConstructPoint(XCoordinate=0, YCoordinate=0, ZCoordinate=expr("-x", number_slider))
unit_z = UnitZ(Factor=1)
line_sdl = LineSDL(Start=construct_point, Direction=unit_z, Length=expr("x*2", number_slider))
mesh_box = MeshBox(Base=center_box, XCount=Slider(60, range=0..100), YCount=Slider(25, range=0..100), ZCount=Slider(60, range=0..100))
twist = Twist(Geometry=mesh_box, Axis=line_sdl, Angle=1.570796327, Infinite=False, Rigid=False)

# ----
# マテリアル
number_slider_2 = Slider(0, range=0..1)
number_slider_3 = Slider(0, range=0..1)
number_slider_4 = Slider(0, range=0..1)
number_slider_5 = Slider(1, range=0..1)
number_slider_6 = Slider(0, range=0..1)
materialparam = MaterialParam(
    XComponent=number_slider_2,
    YComponent=Slider(0, range=0..1),
    ZComponent=Slider(0, range=0..1),
    WComponent=0,
    ParamType=0)
materialparam_2 = MaterialParam(
    XComponent=number_slider_3,
    YComponent=number_slider_4,
    ZComponent=number_slider_5,
    WComponent=number_slider_6,
    ParamType=0)
materialparam_3 = MaterialParam(XComponent=Slider(1, range=0..1), YComponent=Slider(0.5, range=0..1), ZComponent=0, WComponent=0, ParamType=0)
material = Material(Emissive=materialparam, BaseColor=materialparam_2, MetallicRoughness=materialparam_3, ShaderType=0)

series = Series(Start=0, Step=1, Count=10)
unit_x = UnitX(Factor=Slider(100, range=0..100))

# ----
# 書き出し
button = Button()

move = Move(Motion=unit_x)  # -> Geometry, Transform
same_value_tree = SameValueTree(Value=move.Transform, BasedTree=series)  # -> flatten(ResultTree)
colour_cmyk = ColourCMYK(Cyan=number_slider_3, Magenta=number_slider_4, Yellow=number_slider_5, Key=number_slider_6)
c_script = CSharpScript(x=move.Transform)  # -> out, A; inputs x: list of Transform
# ---------- c_script: C# ----------
    GH_Path path = new GH_Path(0);
    DataTree<Transform> ts = new DataTree<Transform>();
    foreach(Transform t in x)
    {
      ts.Add(t, path);
    }
    
    A = ts;
# ---------- end c_script ----------
create_material = CreateMaterial(Diffuse=colour_cmyk, Specular=RGB(255, 255, 255), Emission=RGB(0, 0, 0), Transparency=0, Shine=0)
export = Export(
    Mesh=twist,
    Material=material,
    KeyFrame=series,
    Transform=same_value_tree,
    FolderPath="D:\デスクトップ",
    FileName="test",
    Switch=button,
    ExportStyle=1)
custom_preview = CustomPreview(Geometry=twist, Material=create_material)
