# Grasshopper definition ExportTest_rev2.gh (Grasshopper 1.0.7)
# plug-ins: Shachihoko

# ----
# モデル
number_slider = Slider(10, range=0..10)
center_box = CenterBox(Base=PlaneXY(0, 0, 0), X=Slider(6, range=0..10), Y=Slider(2.5, range=0..10), Z=number_slider)
construct_point = ConstructPoint(XCoordinate=0, YCoordinate=0, ZCoordinate=expr("-x", number_slider))
unit_z = UnitZ(Factor=1)
line_sdl = LineSDL(Start=construct_point, Direction=unit_z, Length=expr("x*2", number_slider))
mesh_box = MeshBox(Base=center_box, XCount=Slider(60, range=0..100), YCount=Slider(25, range=0..100), ZCount=Slider(60, range=0..100))
twist = Twist(Geometry=mesh_box, Axis=line_sdl, Angle=1.570796327, Infinite=False, Rigid=False)

# ----
# マテリアル
number_slider_2 = Slider(0, range=0..1)
number_slider_3 = Slider(1, range=0..1)
number_slider_4 = Slider(0, range=0..1)
number_slider_5 = Slider(0, range=0..1)
number_slider_6 = Slider(0, range=0..1)
materialparam = MaterialParam(
    XComponent=number_slider_2,
    YComponent=Slider(0, range=0..1),
    ZComponent=Slider(0, range=0..1),
    WComponent=0,
    ParamType=0)
materialparam_2 = MaterialParam(
    XComponent=number_slider_3,
    YComponent=number_slider_4,
    ZComponent=number_slider_5,
    WComponent=number_slider_6,
    ParamType=0)
materialparam_3 = MaterialParam(XComponent=Slider(1, range=0..1), YComponent=Slider(0.5, range=0..1), ZComponent=0, WComponent=0, ParamType=0)
material = Material(Emissive=materialparam, BaseColor=materialparam_2, MetallicRoughness=materialparam_3, ShaderType=0)

construct_domain = ConstructDomain(DomainStart=0, DomainEnd=1)
construct_domain_2 = ConstructDomain(DomainStart=0, DomainEnd=Slider(255, range=0..1000))
remap_numbers = RemapNumbers(Value=number_slider_3, Source=construct_domain, Target=construct_domain_2)  # -> Mapped, Clipped
remap_numbers_2 = RemapNumbers(Value=number_slider_4, Source=construct_domain, Target=construct_domain_2)  # -> Mapped, Clipped
remap_numbers_3 = RemapNumbers(Value=number_slider_5, Source=construct_domain, Target=construct_domain_2)  # -> Mapped, Clipped

series = Series(Start=0, Step=1, Count=10)

unit_x = UnitX(Factor=series)
unit_y = UnitY(Factor=series)
unit_z_2 = UnitZ(Factor=Slider(100, range=0..100))

scale_nu = ScaleNU(Plane=PlaneXY(0, 0, 0), ScaleX=1, ScaleY=1, ScaleZ=Slider(1.8, range=0..10))  # -> Geometry, Transform

entwine = Entwine(Branch00=twist, Branch01=twist, FlattenInputs=True)  # -> simplify(Result)

xy_plane = XYPlane(Origin=Point(0, 0, 0))
yz_plane = YZPlane(Origin=Point(0, 0, 0))
xz_plane = XZPlane(Origin=Point(0, 0, 0))

rotate = Rotate(Angle=1.570796327, Plane=xy_plane)  # -> Geometry, Transform

colour_rgb = ColourRGB(Alpha=number_slider_6, Red=remap_numbers.Mapped, Green=remap_numbers_2.Mapped, Blue=remap_numbers_3.Mapped)

move = Move(Motion=unit_x)  # -> Geometry, Transform

move_2 = Move(Motion=unit_y)  # -> Geometry, Transform
create_material = CreateMaterial(Diffuse=colour_rgb, Specular=RGB(255, 255, 255), Emission=RGB(0, 0, 0), Transparency=0, Shine=0)
transform = Transform(Transform=move.Transform)
transform_2 = Transform(Transform=move_2.Transform)

# ----
# 書き出し
button = Button()

custom_preview = CustomPreview(Geometry=twist, Material=create_material)
same_value_tree = SameValueTree(Value=material, BasedTree=entwine)
same_value_tree_2 = SameValueTree(Value=transform, BasedTree=entwine)
entwine_2 = Entwine(Branch00=transform, Branch01=transform_2, FlattenInputs=True)  # -> simplify(Result)
export = Export(
    Mesh=entwine,
    Material=same_value_tree,
    KeyFrame=series,
    Transform=entwine_2,
    FolderPath="D:\デスクトップ",
    FileName="Model",
    Switch=button,
    ExportStyle=1)
